# Grasshopper definition bsp.gh (Grasshopper 1.0.7)

Y = UnitY(Factor=Slider(5, range=0..100))
pt = ConstructPoint(XCoordinate=Slider(72.6, range=-100..100), YCoordinate=Slider(-2.17, range=-100..100), ZCoordinate=0)
pt_2 = ConstructPoint(XCoordinate=Slider(61.07, range=-100..100), YCoordinate=Slider(63.8, range=-100..100), ZCoordinate=0)
pt_3 = ConstructPoint(XCoordinate=Slider(8.93, range=-100..100), YCoordinate=Slider(28.98, range=-100..100), ZCoordinate=0)
pt_4 = ConstructPoint(XCoordinate=Slider(42.42, range=-100..100), YCoordinate=Slider(21.21, range=-100..100), ZCoordinate=0)
move = Move(Geometry=pt, Motion=Y)  # -> Geometry, Transform
move_2 = Move(Geometry=pt_2, Motion=Y)  # -> Geometry, Transform
move_3 = Move(Geometry=pt_3, Motion=Y)  # -> Geometry, Transform
move_4 = Move(Geometry=pt_4, Motion=Y)  # -> Geometry, Transform
dots = DotDisplay(Point=[pt_2, pt, pt_3], Colour=ColourSwatch(SwatchColor=RGB(47, 105, 0)), Size=1)
ln = Line(StartPoint=pt, EndPoint=pt_2)
ln_2 = Line(StartPoint=pt, EndPoint=pt_3)
ln_3 = Line(StartPoint=pt_2, EndPoint=pt_3)
panel = Panel(pt_4)
panel_2 = Panel(pt)
panel_3 = Panel(pt_3)
panel_4 = Panel(pt_2)
dots_2 = DotDisplay(Point=pt_4, Colour=ColourSwatch(SwatchColor=RGB(255, 0, 0)), Size=1)
cluster = Cluster(T=panel)
cluster_2 = Cluster(T=panel_2)
cluster_3 = Cluster(T=panel_3)
cluster_4 = Cluster(T=panel_4)
tag = TextTag(Location=move_4.Geometry, Text=cluster)
tag_2 = TextTag(Location=move.Geometry, Text=cluster_2)
tag_3 = TextTag(Location=move_2.Geometry, Text=cluster_4)
tag_4 = TextTag(Location=move_3.Geometry, Text=cluster_3)

# ==== cluster Cluster
T = ClusterInput()
rep = ReplaceText(Text=T, Find=", 0}", Replace="}", RecursiveReplace=False)
R = ClusterOutput(rep)
